% Simulink data dictionary SensorInterfaces.sldd

GPSInterface = Simulink.Bus()
  SignalStrength: ValueType: SignalStrengthType

SignalStrengthType = Simulink.ValueType(DataType="double", Unit="dB", be=Simulink.BusElement(Name="a", DataType="double"))  % GPS Signal Strength

PhysicalInterface = Simulink.ConnectionBus()
  ElectricalElement: Connection: foundation.electrical.electrical